# Grasshopper definition Blossom_realtime.gh (Grasshopper 1.0.7)
# plug-ins: FologramForGrasshopper

# ---- group: Fologram
devices = ConnectedDevices(device_filter=3, hasSerializedData=True)
device = TrackDevice(Device=devices, hasSerializedData=True, update_mode=1)
state = TrackState(Device=devices, hasSerializedData=True, update_mode=1)

# ---- group: Read csv / Let's use GH to read the CSV file into a List of strings. Make sure you replace the incoming path with wherever your file lives.
panel = Panel("D:\Academics\Harvard\2020 Fall\Introduction to Computational Design\Assignment\assignment[0]\assignment[0]\realtime.csv")
file = ReadFile(File=panel, PerLineParse=True)

# ---- group: Fologram
devices_2 = ConnectedDevices(device_filter=3, hasSerializedData=True)
device_2 = TrackDevice(Device=devices_2, hasSerializedData=True, update_mode=1)
state_2 = TrackState(Device=devices_2, hasSerializedData=True, update_mode=1)

# ---- group: preview REFERENCE device, the mesh is not identical to your device
# #GSD6338
# Introduction to Computational Design
# Instructor: Jose Luis García del Castillo y López
# Harvard University Graduate School of Design
# Fologram_MotionTracker - Tablet Device Recorder
# This file contains a sample Grasshopper definition to record motion information from multiple phones and tablets and save it to a CSV file.
# This file uses the Fologram plug-in to read from the phone and tablet.
# https://fologram.com/
# Authors: Joonhaeng Lee, Jose Luis García del Castillo y Lopez.
# 
# This file is part of a class assignment for GSD6338: Introduction to Computational Design.
# More info on: https://www.gsd.harvard.edu/course/introduction-to-computational-design-fall-2020/
mesh = Mesh(device)
preview = CustomPreview(
    Geometry=mesh,
    Material={diffuse=RGB(221, 160, 221), emission=RGB(66, 48, 66), shine=0.5, specular=RGB(255, 255, 255), transparency=0})

mesh_2 = Mesh(device_2)
preview_2 = CustomPreview(
    Geometry=mesh_2,
    Material={diffuse=RGB(221, 160, 221), emission=RGB(66, 48, 66), shine=0.5, specular=RGB(255, 255, 255), transparency=0})

# ---- group: Read csv / Also simple example of how to read the CSV file, this time outputting geometry elements / Double-click me to learn more!
c_script = CSharpScript(data=file)  # -> out, t0_planes, t0_pressed; inputs data: list of String
# ---------- c_script: C# usings ----------
using System.IO;
using System.Linq;
using System.Data;
using System.Drawing;
using System.Reflection;
using System.Windows.Forms;
using System.Xml;
using System.Xml.Linq;
using System.Runtime.InteropServices;

using Rhino.DocObjects;
using Rhino.Collections;
using GH_IO;
using GH_IO.Serialization;
# ---------- c_script: C# ----------
    // You have seen in the previous example how to read the CSV in an "atomic" way, element by element.
    // However, most likely, you will want to end up reconstructing that data back
    // into Points, Vectors and / or Planes. So why not doing it right away?
    // This example is very similar to the previous one, except that instead of outputting
    // the numerical values representing the origin Point for the first tracker,
    // we will output a List of actual Point3d objects!
    // (Remember, to read more about how to output doubles, booleans or longs,
    // check the previous example. We will ignore that part in this one.)
    // Read the whole file before modifying it!

    // Since we now want to output geometry, let's create an empty list of Point3d
    List<Point3d> t0_origin_point_values = new List<Point3d>();

    // We still will keep the pressed values as single booleans...
    List<bool> t0_pressed_values = new List<bool>();

    // You can now add more lists of Points, Vectors and/or probably Plane objects here!
    // (your code goes here... )
    List<Plane> t0_plane_objects = new List<Plane>();



    // Let's iterate over all the string in the incoming data list, one per line.
    // Notice how we start with 1, because we want to skip the header in the file.
    for (int i = 1; i < data.Count; i++) {
      // Let's retrieve a line will all the data
      string dataRow = data[i];

      // Because it is a Comma-Separated Values (CSV) list, we values are separated with commas.
      // If we split the string with commas, we can get an array of strings with the individual values!
      // https://docs.microsoft.com/en-us/dotnet/api/system.string.split?view=netframework-4.5
      string[] dataColumns = dataRow.Split(',');  // notice how we use single quotes to indicate a char input

      // Bringing in the booleans for `pressed`, just like we did in the previous component.
      int pressedNum = Convert.ToInt32(dataColumns[10]);
      bool pressed = pressedNum == 1;
      t0_pressed_values.Add(pressed);

      // We learnt how to read doubles, longs, bools, etc. before, so let's focus on geometry.
      // If I want to output the origin Point of the tracker, I will probably have to:
      // - Read the string coordinates of the point,
      // - convert them to doubles,
      // - create a Point3d object with them,
      // - and store the point object in my Point3d List.
      // Let's do it!
      double oX = Convert.ToDouble(dataColumns[1]);  // shorthanding reading and converting to double
      double oY = Convert.ToDouble(dataColumns[2]);
      double oZ = Convert.ToDouble(dataColumns[3]);
      Point3d origin = new Point3d(oX, oY, oZ);
      t0_origin_point_values.Add(origin);

      // // The code above could be shorthanded in one line, but it becomes very hard to read... :(
      // t0_origin_point_values.Add(new Point3d(Convert.ToDouble(dataColumns[1]), Convert.ToDouble(dataColumns[2]), Convert.ToDouble(dataColumns[3])));

      // That's pretty much it! Try now importing and constructing the direction Vectors for the tracker.
      // Or... wouldn't it just be easier to directly construct a Plane object for the
      // tracker with the Origin and the two main Vectors...? :)
      // Write code here to create two vectors from the coordinates in the CSV,
      // and either store them on lists or use them along with the origin point
      // to create a Plane object and store that one on a list for outputting! (RECOMMENDED)

      // (your code goes here... )
      Vector3d vx = new Vector3d(
        Convert.ToDouble(dataColumns[4]),
        Convert.ToDouble(dataColumns[5]),
        Convert.ToDouble(dataColumns[6]));
      Vector3d vy = new Vector3d(
        Convert.ToDouble(dataColumns[7]),
        Convert.ToDouble(dataColumns[8]),
        Convert.ToDouble(dataColumns[9]));
      
      Plane pl = new Plane(origin, vx, vy);
      t0_plane_objects.Add(pl);
    }

    // Finally, remember to add more outputs to this GH component,
    // and output the Lists of geometry you just created.
    // t0_origin_points = t0_origin_point_values;

    // Output here your list of `pressed` booleans,
    // and your direction vectors or your orientation plane!
    // (your code goes here... )
    t0_planes = t0_plane_objects;
    t0_pressed = t0_pressed_values;
# ---------- end c_script ----------

# ---- group: Read csv / To view these planes on the viewport, make sure you go to Display > Preview Plane Size > set the value to around 20 units
pln = Plane(c_script.t0_planes)

# ---- group: Read csv / Also simple example of how to read the CSV file, this time outputting geometry elements
panel_2 = Panel(c_script.t0_planes)
panel_3 = Panel(c_script.t0_pressed)

# ---- group: save file / CSV control parameters
use_local_folder = BooleanToggle(True)
panel_4 = Panel("realtime")
save = Button()

# ----
# #BLOSSOM
# Flora Form
# We can visualize the motion directly from the phone if we connect our scripts directly to the data read in real time
lng = ListLength(List=devices)
null = NullItem(Item=state)  # -> NullFlags, InvalidFlags, Description
pln_2 = Plane(device)
point = Point(device)
int = Integer(null.NullFlags)
c_script_2 = CSharpScript(x=Slider(11, range=0..100))  # -> out, A; inputs x: Int32
# ---------- c_script_2: C# ----------
    Plane p = new Plane(new Point3d(x, 0, 0), new Point3d(1, 0, 0), new Point3d(0, 1, 0));
    A = p;
# ---------- end c_script_2 ----------
c_script_3 = CSharpScript(x=Slider(11, range=0..100))  # -> out, A; inputs x: Int32; same code as c_script_2
number_slider = Slider(1000, range=0..1000)
number_slider_2 = Slider(70, range=0..100)
number_slider_3 = Slider(66.3, range=0..100)  # disabled
number_slider_4 = Slider(0.5, range=0..10)  # disabled

# ---- group: For each update of the device, generate a Unix timestamp
c_script_4 = CSharpScript(data=pln_2)  # -> out, timestamp; inputs data: Plane
# ---------- c_script_4: C# ----------
    // This file generates a new UNIX timestamp any time new data is fed to it.

    // The Unix Epoch timestamp is the number of seconds (or milliseconds) that have elapsed
    // since Jan 1st 1970, and it is a very common way of storing time in computers.
    // https://en.wikipedia.org/wiki/Unix_time

    // It doesn't matter which data this component is fed, the data input is only used to monitor
    // changes in data input and trigger the generation of a new stamp; this technique is
    // commonly referred to as using data as a "ticker".

    // Code from: https://stackoverflow.com/a/17632585
    // We use long type because the largest number a 32-bit signed integer can store is 2147483647:
    // https://en.wikipedia.org/wiki/2,147,483,647
    long unixTimestamp = (long) DateTime.UtcNow.Subtract(new DateTime(2019, 10, 1)).TotalMilliseconds;

    // Output
    timestamp = unixTimestamp;
# ---------- end c_script_4 ----------
panel_5 = Panel(c_script_4.timestamp)
c_script_5 = CSharpScript(timestamp=c_script_4.timestamp)  # -> out, humanReadable; inputs timestamp: String
# ---------- c_script_5: C# ----------
    // Grasshopper inputs cannot be set to longs; let's convert the string timestamp to long
    long ts = Convert.ToInt64(timestamp);

    // Let's convert it to seconds; notice how integer division here avoids decimal problems!
    ts /= 1000;

    // Code from: https://stackoverflow.com/a/250400
    // Create a timestamp for Epoch (Jan 1st 1970)
    System.DateTime dtDateTime = new DateTime(2019, 10, 1, 0, 0, 0, 0, System.DateTimeKind.Utc);

    // Add the seconds elapsed since, and convert to human time representation
    humanReadable = dtDateTime.AddSeconds(ts).ToLocalTime();
    Print(ts.ToString());
# ---------- end c_script_5 ----------
panel_6 = Panel(c_script_5.humanReadable)

# ---- group: Simple trick to change 1 to 0, 0 to 1
expression = Expression(x=int, Expression="abs(x-1)")

# ---- group: why using graft? it is for ambitious students who wish to use more than one device
graft = GraftTree(Tree=c_script_4.timestamp, IncludeEmptyLists=True, IncludeNullItems=True)
graft_2 = GraftTree(Tree=pln_2, IncludeEmptyLists=True, IncludeNullItems=True)

# ---- group: Your screen pressed : 1, not pressed: 0
int_2 = Integer(expression)

# ---- group: Number of Devices you are recording
int_3 = Integer(lng)

# ----
# #BLOSSOM
# Box Morph
lng_2 = ListLength(List=devices_2)
null_2 = NullItem(Item=state_2)  # -> NullFlags, InvalidFlags, Description
pln_3 = Plane(device_2)
int_4 = Integer(null_2.NullFlags)

# ---- group: For each update of the device, generate a Unix timestamp
c_script_6 = CSharpScript(data=pln_3)  # -> out, timestamp; inputs data: Plane; same code as c_script_4
panel_7 = Panel(c_script_6.timestamp)
c_script_7 = CSharpScript(timestamp=c_script_6.timestamp)  # -> out, humanReadable; inputs timestamp: String; same code as c_script_5
panel_8 = Panel(c_script_7.humanReadable)

# ---- group: Simple trick to change 1 to 0, 0 to 1
expression_2 = Expression(x=int_4, Expression="abs(x-1)")

# ---- group: why using graft? it is for ambitious students who wish to use more than one device
graft_3 = GraftTree(Tree=c_script_6.timestamp, IncludeEmptyLists=True, IncludeNullItems=True)
graft_4 = GraftTree(Tree=pln_3, IncludeEmptyLists=True, IncludeNullItems=True)

# ---- group: Your screen pressed : 1, not pressed: 0
int_5 = Integer(expression_2)

# ---- group: Number of Devices you are recording
int_6 = Integer(lng_2)

# ---- group: Petal Obejct
c_script_8 = CSharpScript(
    petalStep=Slider(8, range=0..10),
    petalSize=Slider(32, range=0..100),
    p1=Slider(12.92, range=0..100),
    p2=Slider(14, range=0..100),
    patelNum=Slider(2, range=0..100))  # -> out, petals; inputs petalStep: Int32, petalSize: Double, p1: Double, p2: Double, patelNum: Int32, origins: list of Point3d
# ---------- c_script_8: C# ----------
    List<double> range1 = generateRange(petalStep);
    BCurve bc1 = new BCurve(new CurvePoint(0, 0), new CurvePoint(0.3, 0.5), new CurvePoint(0.6, 0.7), new CurvePoint(1, 0.7));
    List<double> bcResult1 = generateBCurvePoints(bc1, range1);
    BCurve bc2 = new BCurve(new CurvePoint(0, 0.4), new CurvePoint(0.1, 0.5), new CurvePoint(0.7, 0.8), new CurvePoint(1, 0));
    List<double> bcResult2 = generateBCurvePoints(bc2, range1);
    List<double> bcMul1 = listMulti(bcResult1, p1);
    List<double> range1Mul = listMulti(range1, p2);
    List<double> bcMul2 = new List<double>();
    List<double> neBcMul2 = new List<double>();
    for(int i = 0; i < bcResult2.Count; i++){
      bcMul2.Add(Math.PI / 2 * bcResult2[i] * 0.83);
      neBcMul2.Add(-Math.PI / 2 * bcResult2[i] * 0.83);
    }

    List<Point3d> pl = generatePointList(range1Mul, bcMul1);

    //rotate points
    List<Point3d> rotatedPoints1 = new List<Point3d>();
    List<Point3d> rotatedPoints2 = new List<Point3d>();
    for(int i = 0; i < pl.Count; i++){
      rotatedPoints1.Add(gRotate(pl[i], bcMul2[i]));
      rotatedPoints2.Add(gRotate(pl[i], neBcMul2[i]));
    }

    //Curve c1 = Curve.CreateInterpolatedCurve(pl, 3);
    //Curve c2 = Curve.CreateInterpolatedCurve(rotatedPoints1, 3);
    //Curve c3 = Curve.CreateInterpolatedCurve(rotatedPoints2, 3);

    List<Curve> curves = new List<Curve>();
    curves.Add(Curve.CreateInterpolatedCurve(rotatedPoints1, 3));
    curves.Add(Curve.CreateInterpolatedCurve(pl, 3));
    curves.Add(Curve.CreateInterpolatedCurve(rotatedPoints2, 3));
    Brep[] srf = Brep.CreateFromLoft(curves, Point3d.Unset, Point3d.Unset, LoftType.Normal, false);
    List<Brep> gl = new List<Brep>();
    //Brep[] tmp = new Brep[srf.Length];
    Brep bMerge = Brep.MergeBreps(srf, 1);
    for(int i = 0; i < patelNum; i++){
      Brep tmp = Brep.MergeBreps(srf, 1);
      tmp.Rotate(i * 0.6, new Vector3d(0, 0, 1), new Point3d(0, 0, 0));
      gl.Add(tmp);
    }
    /*for(int i = 0; i < patelNum;i++){
      //bMerge.Translate(i, 0, 0);
      gl.Add(bMerge);
    }
    //gl.Add(srf);
    List<Sphere> tt = new List<Sphere>();
    tt.Add(new Sphere(new Point3d(0, 0, 0), 10));*/
    //loftOut = srf;
    petals = gl;

    /*curve1 = c1;
    curve2 = c2;
    curve3 = c3;
    bcMul1Out = bcMul1;
    bcMul2Out = bcMul2;
    rangeMulOut = range1Mul;
    neBcMul2Out = neBcMul2;
    pointList = pl;
    rotatedPointList1 = rotatedPoints1;
    rotatedPointList2 = rotatedPoints2;*/
# ---------- c_script_8: C# additional code ----------
  public class CurvePoint{
    public double x;
    public double y;
    public CurvePoint(double xv, double yv){
      this.x = xv;
      this.y = yv;
    }
  }

  public class BCurve{
    public CurvePoint start;
    public CurvePoint end;
    public CurvePoint h1;
    public CurvePoint h2;
    public BCurve(CurvePoint p1, CurvePoint p2, CurvePoint p3, CurvePoint p4){
      this.start = p1;
      this.end = p4;
      this.h1 = p2;
      this.h2 = p3;
    }
  }

  public Point3d gRotate(Point3d g, double angle){
    Plane p = new Plane(new Point3d(0, 0, 0), new Vector3d(1, 0, 0), new Vector3d(0, 1, 0));
    Transform xform = Transform.Rotation(angle, p.Normal, p.Origin);
    //X = xform;
    Point3d gOut = new Point3d(0, 0, 0);
    if(g != null){
      g.Transform(xform);
      gOut = g;
    }
    return gOut;
  }

  /*public Geometrybase  gRotate2(Geometrybase g, double angle){
    Plane p = new Plane(new Point3d(0, 0, 0), new Vector3d(1, 0, 0), new Vector3d(0, 1, 0));
    Transform xform = Transform.Rotation(angle, p.Normal, p.Origin);
    //X = xform;
    Geometrybase  gOut = new Geometrybase(;
    if(g != null){
      g.Transform(xform);
      gOut = g;
    }
    return gOut;
  }*/

  public List<Point3d> generatePointList(List<double> yl, List<double> zl){
    List<Point3d> pl = new List<Point3d>();
    for(int i = 0; i < yl.Count; i++){
      pl.Add(new Point3d(0, yl[i], zl[i]));
    }
    return pl;
  }

  public List<double> listMulti(List<double> l, double mul){
    List<double> result = new List<double>();
    for(int i = 0; i < l.Count; i++){
      result.Add(l[i] * mul);
    }
    return result;
  }

  public List<double> generateRange(int step){
    List<double> r = new List<double>();
    for(int i = 0; i < step; i++){
      r.Add(1 / (double) (step - 1) * i);
    }
    return r;
  }

  public List<double> generateBCurvePoints(BCurve bc, List<double> inputNum){
    List<double> result = new List<double>();
    for(int i = 0; i < inputNum.Count; i++){
      double y = bc.start.y * Math.Pow(1 - inputNum[i], 3) + bc.h1.y * 3 * Math.Pow(1 - inputNum[i], 2) * inputNum[i] + bc.h2.y * 3 * (1 - inputNum[i]) * Math.Pow(inputNum[i], 2) + bc.end.y * Math.Pow(inputNum[i], 3);
      //double ry = a[1] * Math.Pow(1 - inputNum[i], 3) + b[1] * 3 * Math.Pow(1 - x[i], 2) * x[i] + c[1] * 3 * (1 - x[i]) * Math.Pow(x[i], 2) + d[1] * Math.Pow(x[i], 3);
      result.Add(y);
    }
    return result;
  }

  /// <summary>
  /// This method will be called once every solution, before any calls to RunScript.
  /// </summary>
  public override void BeforeRunScript()
  { }
  /// <summary>
  /// This method will be called once every solution, after any calls to RunScript.
  /// </summary>
  public override void AfterRunScript()
  { }
# ---------- end c_script_8 ----------

# ----
entwine = Entwine(Branch00=graft, Branch01=graft_2, Branch02=int_2, Branch03=int_3, FlattenInputs=True)

# ---- group: RECORD!
rec = DataRecorder(entwine, DataLimit=-10, RecordData=False)

# ----
entwine_2 = Entwine(Branch00=graft_3, Branch01=graft_4, Branch02=int_5, Branch03=int_6, FlattenInputs=True)
brep = Brep(c_script_8.petals)

# ---- group: RECORD!
rec_2 = DataRecorder(entwine_2, DataLimit=-10, RecordData=False)

# ---- group: save file
bang = ExplodeTree(Data=rec_2)  # -> flatten(Branch0), flatten(Branch1), flatten(Branch2), Branch3
item = ListItem(List=bang.Branch3, Index=0, Wrap=True)
txt = Text(bang.Branch0)
number_of_recorded_devices = Panel(item)
int_7 = Integer(number_of_recorded_devices)
c_script_9 = CSharpScript(
    name=panel_4,
    useLocalFolder=use_local_folder,
    save=save,
    timeStamp=txt,
    plane=bang.Branch1,
    trackState=bang.Branch2,
    deviceCount=Slider(2, range=0..10))  # -> out; inputs name: String, useLocalFolder: Boolean, save: Boolean, timeStamp: list of String, plane: list of Plane, trackState: list of Int32, deviceCount: Int32
# ---------- c_script_9: C# ----------
    // This component only runs only "save" is ture
    // Reading, spliting, and writing data takes time. And you do not need to do this process multiple times.
    // So this following code are designed to only run once when you click the button "Save?"
    if (save == false) {
      return;
    }

    // Check the number of devices that you recorded.
    Print(deviceCount.ToString() + " device(s) found");

    // Creates empty list to store all data you are going to export to CSV.
    // The data we are going to export is TEXT, so the type of the list is string.
    List<string> dataRecordAll = new List<string>();

    // Make a string variable which will stores data of each time stamp
    string datarecord;

    // Check how many lines(frames) of data we are going to store.
    // Each iteration "Rec" component record n rows of data, when n is the number of devices you are working with.
    // timeStamp for example, there will be 2 identical time stamp in data if you use two recording devices.
    int num = timeStamp.Count / deviceCount;

    // Let's print how many data we got.
    Print(num.ToString() + " data entries");

    // in for loop, rows of timeStamp, plane, trackStates saved in datarecord as string.
    for (int i = 0; i < num;i++){

      datarecord = timeStamp[i * deviceCount] + ",";

      for (int j = 0; j < deviceCount ; j++){

        datarecord = datarecord
          + plane[i * deviceCount + j].Origin.X.ToString() + ","
          + plane[i * deviceCount + j].Origin.Y.ToString() + ","
          + plane[i * deviceCount + j].Origin.Z.ToString() + ","
          + plane[i * deviceCount + j].XAxis.X.ToString() + ","
          + plane[i * deviceCount + j].XAxis.Y.ToString() + ","
          + plane[i * deviceCount + j].XAxis.Z.ToString() + ","
          + plane[i * deviceCount + j].YAxis.X.ToString() + ","
          + plane[i * deviceCount + j].YAxis.Y.ToString() + ","
          + plane[i * deviceCount + j].YAxis.Z.ToString() + ","
          ;

        if ( j < deviceCount - 1){
          datarecord = datarecord + trackState[i * deviceCount + j] + ",";
        }
        else{
          datarecord = datarecord + trackState[i * deviceCount + j];
        }

      }

      // After reading a set of data, add this to the list we created at the begining.
      dataRecordAll.Add(datarecord);
    }

    int frames = dataRecordAll.Count;
    string csv = ShortHeaders(deviceCount);
    for(int i = 0; i < frames; i++){
      csv = csv + dataRecordAll[i] + "\n";
    }

    string targetFolder = "";
    if (useLocalFolder) {
      // https://www.grasshopper3d.com/forum/topics/get-location-of-current-grasshopper-file
      GH_Document gh_d = owner.OnPingDocument();
      if (gh_d.IsFilePathDefined)
      {
        // Figure out the path of this GH file.
        string ghFilePath = gh_d.FilePath;
        // Remove the filename from it
        targetFolder = Path.GetDirectoryName(ghFilePath);
      }
      else
      {
        Print("No local folder found, please save your file locally.");
      }
    }
      // Otherwise, use the Desktop folder
    else {
      // First, we need to figure out the path to your Desktop:
      targetFolder = Environment.GetFolderPath(Environment.SpecialFolder.Desktop);
    }

    // Add the name of the file to the destination folder
    string filepath = Path.Combine(targetFolder, name + ".csv");
    Print("Destination file: " + filepath);

    File.WriteAllText(filepath, csv);
    Print("File " + filepath + " has been saved!");
# ---------- c_script_9: C# additional code ----------
  static string ShortHeaders(int deviceCount) {
    string headers = "TIMESTAMP,";

    for (int i = 0; i < deviceCount ; i++){
      headers = headers + "ORIGIN_X,ORIGIN_Y,ORIGIN_Z,XAXIS_X,XAXIS_Y,XAXIS_Z,YAXIS_X,YAXIS_Y,YAXIS_Z,";

      if (i < deviceCount - 1){
        headers = headers + "STATE,";
      }
      else{
        headers = headers + "STATE";
      }
    }
    headers = headers + "\n";


    return headers;
  }
# ---------- end c_script_9 ----------

# ----
bang_2 = ExplodeTree(Data=rec)  # -> flatten(Branch0), flatten(Branch1), flatten(Branch2), Branch3; disabled

num = Number(bang_2.Branch0)
bool = Boolean(bang_2.Branch2)
pln_4 = Plane(bang_2.Branch1)

# ---- group: And just a simple example to inspire you!
c_script_10 = CSharpScript(planes=pln_4, pressed=bool, radius=Slider(100, range=0..100))  # -> out, lines, trajectory, pressedBubbles; inputs planes: list of Plane, pressed: list of Boolean, radius: Double
# ---------- c_script_10: C# ----------
    // And some bonus sample code:
    // let's create perpendicular lines to the planes,
    // a polyline over all the planes,
    // and place spheres on those moments where the user pressed the screen!

    // To create perpendicular lines to the plane,
    // we start an empty List, and we add one line per input plane
    List<Line> perpLines = new List<Line>();
    for (int i = 0; i < planes.Count; i++) {
      // Get plane from list
      Plane plane = planes[i];

      // Create a line perp to the plane
      Point3d endPoint = plane.Origin + plane.ZAxis * radius;
      Line lin = new Line(plane.Origin, endPoint);

      // Add it to the list
      perpLines.Add(lin);
    }


    // To create a Polyline object, we need a List of points.
    // Since what we have is Planes, we need to extract all the
    // origins into a new list and use that to create the Polyline:
    List<Point3d> origins = new List<Point3d>();
    for (int i = 0; i < planes.Count; i++) {
      Point3d orig = planes[i].Origin;
      origins.Add(orig);
    }
    Polyline poly = new Polyline(origins);

    // Now, let's create an empty list of sphere objects,
    // and only create them if there was a `pressed` event:
    List<Sphere> spheres = new List<Sphere>();
    for (int i = 9; i < pressed.Count; i++) {
      bool wasPressed = pressed[i];
      if (wasPressed == true) {
        Sphere s = new Sphere(planes[i], radius);
        spheres.Add(s);
      }
    }

    // Outputs
    lines = perpLines;
    trajectory = poly;
    pressedBubbles = spheres;
# ---------- end c_script_10 ----------
geo = Geometry(c_script_10.lines)
geo_2 = Geometry(c_script_10.pressedBubbles)
geo_3 = Geometry(c_script_10.trajectory)

# ----
bang_3 = ExplodeTree(Data=rec_2)  # -> flatten(Branch0), flatten(Branch1), flatten(Branch2), Branch3

num_2 = Number(bang_3.Branch0)
pln_5 = Plane(bang_3.Branch1)
bool_2 = Boolean(bang_3.Branch2)

# ----
# We draw a box whose base plane is interactively changing with respect to your cell phone frame.
bang_4 = ExplodeTree(Data=rec)  # -> flatten(Branch0), flatten(Branch1), flatten(Branch2), Branch3
number_slider_5 = Slider(849, range=0..1000)  # disabled
number_slider_6 = Slider(29.4, range=0..90)  # disabled
c_script_11 = CSharpScript(
    w=Slider(9, range=0..10),
    phoneframe=bang_4.Branch1,
    hyperParam=number_slider_5,
    c=number_slider_6,
    densityT=number_slider_3,
    speedT=number_slider_4,
    petalStep=Slider(8, range=0..10),
    petalSize=Slider(19, range=0..100),
    p1=Slider(19.36, range=0..100),
    p2=Slider(33.89, range=0..100))  # -> out, D, B, A, C, E, F; inputs w: Double, phoneframe: list of Plane, hyperParam: Double, c: Double, densityT: Double, speedT: Double, petalStep: Int32, petalSize: Int32, p1: Double, p2: Double
# ---------- c_script_11: C# usings ----------
using System.IO;
using System.Linq;
using System.Data;
using System.Drawing;
using System.Reflection;
using System.Windows.Forms;
using System.Xml;
using System.Xml.Linq;
using System.Runtime.InteropServices;

using Rhino.DocObjects;
using Rhino.Collections;
using GH_IO;
using GH_IO.Serialization;
using GHgradient = Grasshopper.GUI.Gradient.GH_Gradient;
# ---------- c_script_11: C# ----------
    List<Brep> flowers = new List<Brep>();//record all breps of all flowers
    for(int i = 0; i < phoneframe.Count; i++){
      /*
       * use density to control the number of petals
       * calculate density: use the average distance of the 3-nearest-neighbors
       */
      double density = 0;
      int count = 0;
      for(int j = i - 3; j < i + 3; j++){
        if(j >= 0 && j <= phoneframe.Count - 1){
          density += phoneframe[j].Origin.DistanceTo(phoneframe[i].Origin);
          count++;
        }
      }
      density /= count;

      /*
       * calculate number with density, number range -> [1, 10]
       */
      int patelNum = (int) Math.Floor(density * 4);
      if(patelNum > 10){
        patelNum = 10;
      }else if(patelNum < 0){
        patelNum = 1;
      }
      List<Brep> flower = drawFlower(petalStep, petalSize, p1, p2, patelNum);

      Plane basePlane = new Plane(new Point3d(0, 0, 0), Vector3d.ZAxis);
      Transform trans = Rhino.Geometry.Transform.PlaneToPlane(basePlane, phoneframe[i]);
      for(int m = 0; m < flower.Count; m++){
        flower[m].Transform(trans);
      }
      for(int m = 0; m < flower.Count; m++){
        flowers.Add(flower[m]);
      }
    }
    List<Brep> floweraa = drawFlower(petalStep, petalSize, p1, p2, 10);
    A = flowers;
# ---------- c_script_11: C# additional code ----------
  public static double Map (double value, double sourceMin, double sourceMax, double targetMin, double targetMax)
  {
    return (value - sourceMin) / (sourceMax - sourceMin) * (targetMax - targetMin) + targetMin;
  }

  public class CurvePoint{
    public double x;
    public double y;
    public CurvePoint(double xv, double yv){
      this.x = xv;
      this.y = yv;
    }
  }

  public class BCurve{
    public CurvePoint start;
    public CurvePoint end;
    public CurvePoint h1;
    public CurvePoint h2;
    public BCurve(CurvePoint p1, CurvePoint p2, CurvePoint p3, CurvePoint p4){
      this.start = p1;
      this.end = p4;
      this.h1 = p2;
      this.h2 = p3;
    }
  }

  public List<Brep> drawFlower(int petalStep, double petalSize, double p1, double p2, int patelNum){
    List<double> range1 = generateRange(petalStep);
    BCurve bc1 = new BCurve(new CurvePoint(0, 0), new CurvePoint(0.3, 0.5), new CurvePoint(0.6, 0.7), new CurvePoint(1, 0.7));
    List<double> bcResult1 = generateBCurvePoints(bc1, range1);
    BCurve bc2 = new BCurve(new CurvePoint(0, 0.4), new CurvePoint(0.1, 0.5), new CurvePoint(0.7, 0.8), new CurvePoint(1, 0));
    List<double> bcResult2 = generateBCurvePoints(bc2, range1);
    List<double> bcMul1 = listMulti(bcResult1, p1);
    List<double> range1Mul = listMulti(range1, p2);
    List<double> bcMul2 = new List<double>();
    List<double> neBcMul2 = new List<double>();
    for(int i = 0; i < bcResult2.Count; i++){
      bcMul2.Add(Math.PI / 2 * bcResult2[i] * 0.83);
      neBcMul2.Add(-Math.PI / 2 * bcResult2[i] * 0.83);
    }

    List<Point3d> pl = generatePointList(range1Mul, bcMul1);

    //rotate points
    List<Point3d> rotatedPoints1 = new List<Point3d>();
    List<Point3d> rotatedPoints2 = new List<Point3d>();
    for(int i = 0; i < pl.Count; i++){
      rotatedPoints1.Add(gRotate(pl[i], bcMul2[i]));
      rotatedPoints2.Add(gRotate(pl[i], neBcMul2[i]));
    }

    List<Curve> curves = new List<Curve>();
    curves.Add(Curve.CreateInterpolatedCurve(rotatedPoints1, 3));
    curves.Add(Curve.CreateInterpolatedCurve(pl, 3));
    curves.Add(Curve.CreateInterpolatedCurve(rotatedPoints2, 3));
    Brep[] srf = Brep.CreateFromLoft(curves, Point3d.Unset, Point3d.Unset, LoftType.Normal, false);
    List<Brep> gl = new List<Brep>();
    Brep bMerge = Brep.MergeBreps(srf, 1);
    for(int i = 0; i < patelNum; i++){
      Brep tmp = Brep.MergeBreps(srf, 1);
      tmp.Rotate(i * 0.5, new Vector3d(0, 0, 1), new Point3d(0, 0, 0));
      gl.Add(tmp);
    }
    return gl;
  }

  public Point3d gRotate(Point3d g, double angle){
    Plane p = new Plane(new Point3d(0, 0, 0), new Vector3d(1, 0, 0), new Vector3d(0, 1, 0));
    Transform xform = Transform.Rotation(angle, p.Normal, p.Origin);
    //X = xform;
    Point3d gOut = new Point3d(0, 0, 0);
    if(g != null){
      g.Transform(xform);
      gOut = g;
    }
    return gOut;
  }

  public List<Point3d> generatePointList(List<double> yl, List<double> zl){
    List<Point3d> pl = new List<Point3d>();
    for(int i = 0; i < yl.Count; i++){
      pl.Add(new Point3d(0, yl[i], zl[i]));
    }
    return pl;
  }

  public List<double> listMulti(List<double> l, double mul){
    List<double> result = new List<double>();
    for(int i = 0; i < l.Count; i++){
      result.Add(l[i] * mul);
    }
    return result;
  }

  public List<double> generateRange(int step){
    List<double> r = new List<double>();
    for(int i = 0; i < step; i++){
      r.Add(1 / (double) (step - 1) * i);
    }
    return r;
  }

  public List<double> generateBCurvePoints(BCurve bc, List<double> inputNum){
    List<double> result = new List<double>();
    for(int i = 0; i < inputNum.Count; i++){
      double y = bc.start.y * Math.Pow(1 - inputNum[i], 3) + bc.h1.y * 3 * Math.Pow(1 - inputNum[i], 2) * inputNum[i] + bc.h2.y * 3 * (1 - inputNum[i]) * Math.Pow(inputNum[i], 2) + bc.end.y * Math.Pow(inputNum[i], 3);
      //double ry = a[1] * Math.Pow(1 - inputNum[i], 3) + b[1] * 3 * Math.Pow(1 - x[i], 2) * x[i] + c[1] * 3 * (1 - x[i]) * Math.Pow(x[i], 2) + d[1] * Math.Pow(x[i], 3);
      result.Add(y);
    }
    return result;
  }

  /// <summary>
  /// This method will be called once every solution, before any calls to RunScript.
  /// </summary>
  public override void BeforeRunScript()
  { }
  /// <summary>
  /// This method will be called once every solution, after any calls to RunScript.
  /// </summary>
  public override void AfterRunScript()
  { }
# ---------- end c_script_11 ----------
gradient = Gradient(
    LowerLimit=0,
    UpperLimit=1,
    Parameter=c_script_11.D,
    stops=[0: RGB(234, 38, 0), 0.478: RGB(234, 126, 0), 1: RGB(75, 107, 169)])

geo_4 = Geometry(c_script_11.A)
geo_5 = Geometry(c_script_11.C)
geo_6 = Geometry(geo_4)

custom_preview = CustomPreview(Geometry=geo_5, Material=gradient)

area = Area(Geometry=geo_6)  # -> Area, Centroid
bnd = Bounds(Numbers=area.Area)
dedomain = DeconstructDomain(Domain=bnd)  # -> Start, End
gradient_2 = Gradient(
    LowerLimit=dedomain.Start,
    UpperLimit=dedomain.End,
    Parameter=area.Area,
    stops=[0: RGB(123, 59, 191), 0: RGB(101, 228, 30), 0: RGB(114, 142, 154), 0: RGB(241, 85, 165), 0: RGB(236, 182, 122), 0.357: RGB(255, 130, 160), 0.729: RGB(220, 0, 40)])
preview_3 = CustomPreview(Geometry=geo_6, Material=gradient_2)

box_morph = CSharpScript(
    planes=pln_5,
    pressed=bool_2,
    height=Slider(11, range=0..100),
    width=Slider(79, range=0..100),
    length=Slider(445, range=0..500),
    source=brep)  # -> trajectory, boxCollection, boxMorph, boxMorph2; inputs planes: list of Plane, pressed: list of Boolean, height: Double, width: Double, length: Double, source: Brep
# ---------- box_morph: C# ----------
    //PolyLines
    List<Point3d> origins = new List<Point3d>();
    for (int i = 0; i < planes.Count; i++) {
      Point3d orig = planes[i].Origin;
      origins.Add(orig);
    }
    Polyline poly = new Polyline(origins);

    // Boxes
    List <Box> boxes = new List<Box>();
    Interval ix = new Interval(-0.5 * width, 0.5 * width);
    Interval iy = new Interval(-0.5 * length, 0.5 * length);
    double factorHeight = 0;
    for (int i = 0; i < planes.Count; i++)
    {
      if (i > 0){
        factorHeight = planes[i].Origin.DistanceTo(planes[i - 1].Origin);
      }
      Interval iz = new Interval(0, height * factorHeight);
      Box b = new Box(planes[i], ix, iy, iz);
      boxes.Add(b);
    }

    // Box Morph
    // Find orient base plane
    BoundingBox bbx = source.GetBoundingBox(true);
    Box bx = new Box(bbx);
    Point3d[] corners = bx.GetCorners();
    double xCenter = (corners[0].X + corners[1].X) / 2;
    double yCenter = (corners[1].Y + corners[2].Y) / 2;
    Point3d baseOrigin = new Point3d(xCenter, yCenter, corners[0].Z);
    Plane basePlane = new Plane(baseOrigin, Vector3d.ZAxis);
    // Transform Brep
    List<Brep> morphCollection = new List<Brep>();
    List<Brep> morphCollection2 = new List<Brep>();
    for (int i = 0; i < boxes.Count; i++)
    {
      Transform xform = Rhino.Geometry.Transform.PlaneToPlane(basePlane, planes[i]);
      Brep morph = source.DuplicateBrep();
      morph.Transform(xform);
      double xscale = boxes[i].X.Length / bx.X.Length;
      double yscale = boxes[i].Y.Length / bx.Y.Length;
      double zscale = boxes[i].Z.Length / bx.Z.Length;
      Transform scale = Rhino.Geometry.Transform.Scale(planes[i], xscale, yscale, zscale);
      morph.Transform(scale);
      if(pressed[i]){
        morphCollection2.Add(morph);
      }
      else{
        morphCollection.Add(morph);
      }
    }

    // Outputs
    trajectory = poly;
    boxCollection = boxes;
    boxMorph = morphCollection;
    boxMorph2 = morphCollection2;
# ---------- end box_morph ----------
geo_7 = Geometry(box_morph.boxMorph)
geo_8 = Geometry(box_morph.boxMorph2)

# ---- group: if not pressed, gradient palette 1
area_2 = Area(Geometry=geo_7)  # -> Area, Centroid
bnd_2 = Bounds(Numbers=area_2.Area)
dedomain_2 = DeconstructDomain(Domain=bnd_2)  # -> Start, End
gradient_3 = Gradient(
    LowerLimit=dedomain_2.Start,
    UpperLimit=dedomain_2.End,
    Parameter=area_2.Area,
    stops=[0: RGB(123, 59, 191), 0: RGB(101, 228, 30), 0: RGB(114, 142, 154), 0: RGB(241, 85, 165), 0: RGB(236, 182, 122), 0.586: RGB(255, 130, 160), 0.83: RGB(220, 0, 40)])
preview_4 = CustomPreview(Geometry=geo_7, Material=gradient_3)

# ---- group: if pressed, gradient palette 2
area_3 = Area(Geometry=geo_8)  # -> Area, Centroid
bnd_3 = Bounds(Numbers=area_3.Area)
dedomain_3 = DeconstructDomain(Domain=bnd_3)  # -> Start, End

# ----
gradient_4 = Gradient(
    LowerLimit=dedomain_3.Start,
    UpperLimit=dedomain_3.End,
    Parameter=area_3.Area,
    stops=[0: RGB(243, 57, 0), 0.1: RGB(236, 27, 60), 0.2: RGB(210, 0, 118), 0.3: RGB(103, 0, 120), 0.4: RGB(39, 72, 161), 0.5: RGB(1, 192, 229), 0.6: RGB(18, 178, 90), 0.7: RGB(79, 186, 8), 0.8: RGB(220, 237, 32), 0.9: RGB(247, 159, 20), 1: RGB(243, 57, 0)])

# ---- group: if pressed, gradient palette 2 (continued)
preview_5 = CustomPreview(Geometry=geo_8, Material=gradient_4)
